# Grasshopper definition gocce_pattern.gh (Grasshopper 1.0.8)

number_slider = Slider(20, range=0..100)
rectangle = Rectangle(Plane=PlaneXY(0, 0, 0), XSize=number_slider, YSize=number_slider, Radius=0)  # -> Rectangle, Length
py3 = Python3Script(port="COM8", baud="115200")  # -> Radius, HitPoint, Seed; inputs port: String, baud: Int32
# ---------- py3: Python ----------
# r: pyserial
import Rhino
import Rhino.Geometry as rg
import scriptcontext as sc
import serial
import random
import time

sticky = sc.sticky

# Cache component reference to maintain background loop stability
sticky["comp_ref"] = ghenv.Component

# ==========================================
# 🛠️ CALIBRATION & GRID BOUNDARY LOCK
# ==========================================
PHYSICAL_X_MIN = -500.0
PHYSICAL_X_MAX =  500.0
PHYSICAL_Y_MIN = -500.0
PHYSICAL_Y_MAX =  500.0

TARGET_X_MIN = 0.0
TARGET_X_MAX = 20.0
TARGET_Y_MIN = 0.0
TARGET_Y_MAX = 20.0

def remap_and_clamp(val, src_min, src_max, dst_min, dst_max):
    if src_max == src_min: 
        return dst_min
    mapped = dst_min + ((float(val) - src_min) / (src_max - src_min)) * (dst_max - dst_min)
    return max(dst_min, min(mapped, dst_max))
# ==========================================

# Initialize persistent tracking variables if they don't exist
if "last_pt" not in sticky:
    sticky["last_pt"] = rg.Point3d(10.0, 10.0, 0.0)
if "radius_val" not in sticky:
    sticky["radius_val"] = 35.0
if "current_seed" not in sticky:
    sticky["current_seed"] = random.randint(1, 99999)
if "last_seed_time" not in sticky:
    sticky["last_seed_time"] = time.time()

current_port = str(port) if 'port' in locals() and port is not None else "COM8"
current_baud = int(baud) if 'baud' in locals() and baud is not None else 115200

# --- SYSTEM RESET STATE ---
if current_port == "RESET":
    if "ser_conn" in sticky and sticky["ser_conn"] is not None:
        try: 
            sticky["ser_conn"].close()
        except: 
            pass
        sticky["ser_conn"] = None
    sticky["last_pt"] = rg.Point3d(10.0, 10.0, 0.0) 
    sticky["radius_val"] = 35.0
    print("🛑 SYSTEM RESET. CHANGE PANEL BACK TO COM8.")

else:
    ser = sticky.get("ser_conn", None)

    # --- SERIAL PORT CONNECTION ---
    if ser is None or not ser.is_open:
        try:
            ser = serial.Serial(current_port, current_baud, timeout=0.001)
            sticky["ser_conn"] = ser
            print(f"✅ LIVE: Monitoring {current_port}")
        except Exception as e:
            ser = None

    # --- INCOMING DATA & RADIUS RESET ---
    if ser and ser.is_open:
        try:
            waiting = ser.in_waiting
            if waiting > 0:
                raw_data = ser.read(waiting).decode('utf-8', errors='ignore')
                lines = raw_data.split('\n')
                
                for l in reversed(lines):
                    l = l.strip()
                    if "," in l:
                        try:
                            parts = l.split(",")
                            raw_x = float(parts[0])
                            raw_y = float(parts[1])
                            
                            mapped_x = remap_and_clamp(raw_x, PHYSICAL_X_MIN, PHYSICAL_X_MAX, TARGET_X_MIN, TARGET_X_MAX)
                            mapped_y = remap_and_clamp(raw_y, PHYSICAL_Y_MIN, PHYSICAL_Y_MAX, TARGET_Y_MIN, TARGET_Y_MAX)
                            
                            print(f"💥 IMPACT: Enforced Grid({mapped_x:.2f}, {mapped_y:.2f})")
                            
                            sticky["last_pt"] = rg.Point3d(mapped_x, mapped_y, 0)
                            sticky["radius_val"] = 0.0  # Force Radius to 0 instantly on fresh impact
                            break
                        except:
                            continue
        except Exception as e:
            try: 
                ser.close()
            except: 
                pass
            sticky["ser_conn"] = None

    # --- RADIUS GROWTH ANIMATION ENGINE ---
    current_r = sticky["radius_val"]
    if current_r < 35.0:
        current_r += 2.5  # Growth speed step per loop tick
        if current_r > 35.0:
            current_r = 35.0  # Clamp hard at exactly 35
        sticky["radius_val"] = current_r

# --- CONSTANT SEED GENERATOR ENGINE (0.1 Sec Interval) ---
now = time.time()
if now - sticky["last_seed_time"] >= 0.1:
    sticky["current_seed"] = random.randint(0, 3)
    sticky["last_seed_time"] = now

# Final Downstream Parameter Assignment
Radius = sticky["radius_val"]
HitPoint = sticky["last_pt"]
Seed = sticky["current_seed"]

# --- STABLE BACKGROUND TIMING LOOP ---
def refresh(doc):
    import scriptcontext as sc
    comp = sc.sticky.get("comp_ref")
    if comp:
        comp.ExpireSolution(False)
        
ghenv.Component.OnPingDocument().ScheduleSolution(20, refresh)
# ---------- end py3 ----------
pop2d = Populate2D(Region=rectangle.Rectangle, Count=Slider(500, range=0..10000), Seed=py3.Seed)
dist = Distance(PointA=pop2d, PointB=py3.HitPoint)
thickness = Slider(1, range=0..100)
subtraction = Subtraction(A=py3.Radius, B=thickness)
larger = LargerThan(FirstNumber=dist, SecondNumber=py3.Radius)  # -> LargerThan, OrEqualTo
smaller = SmallerThan(FirstNumber=dist, SecondNumber=subtraction)  # -> SmallerThan, OrEqualTo
or = GateOr(A=larger.LargerThan, B=smaller.SmallerThan)
cull = CullPattern(List=pop2d, CullPattern=or)
preview = CustomPreview(Geometry=cull, Material=ColourSwatch(SwatchColor=RGB(30, 130, 255)))
